# Grasshopper definition IfcHopperShell.ghx (Grasshopper 1.0.8)

# ----
# 1 - File
ifcmodel = Python3Script()  # -> model_out; inputs schema_version: String
#   port schema_version: The version of IFC. Can be "IFC2X3", "IFC4" or "IFC4X3". (Default is "IFC4")
#   port name: The name of the model. (Default is "Hopper Model")
#   port description: The description of the model. (Default is "...")
#   port author_name: The author name of the model. (Default is "...")
#   port author_surname: The author surname of the model. (Default is "...")
#   port organization: The organization authring of the model. (Default is "...")
#   port authorization: The manager responsible for the model. (Default is "...")
#   port model_out: The IfcOpenShell model.
# ---------- ifcmodel: Python ----------
import ifcopenshell.api.project
from datetime import datetime

# Set default values
if schema_version == None:
    schema_version = "IFC4"

if name == None:
    name = "Hopper Model"

if description == None:
    description = "..."

if author_name == None:
    author_name = "..."

if author_surname == None:
    author_surname = "..."

if organization == None:
    organization = "..."

if authorization == None:
    authorization = "..."

# Initialize model
model = None

# Set owner history if IFC2X3
if (schema_version == "IFC2X3"):

    # Create a new IFC file of the specified version
    model = ifcopenshell.api.project.create_file(version=schema_version)

    application = ifcopenshell.api.owner.add_application(model)

    # Add a person to the IFC file, using their given and family names to create an identification code
    person = ifcopenshell.api.owner.add_person(
        model,
        identification=(author_name + " " + author_surname).lower().replace(" ", "_"),
        family_name=author_name,
        given_name=author_surname
    )

    # Add an organisation to the IFC file, using its identification and name
    organisation = ifcopenshell.api.owner.add_organisation(
        model,
        identification=organization.lower().replace(" ", "_"),
        name=organization
    )

    # Link the person and organisation, creating a user entity in the model
    user = ifcopenshell.api.owner.add_person_and_organisation(
        model,
        person=person,
        organisation=organisation
    )

    # Set the API's user and application settings to the ones just created
    ifcopenshell.api.owner.settings.get_user = lambda x: user
    ifcopenshell.api.owner.settings.get_application = lambda x: application

    # Create the owner history entity in the IFC file, required for some IFC versions
    ifcopenshell.api.owner.create_owner_history(model)
else:

    # If not 'IFC2X3' and 'ownerHistory' is not set, simply create the file without owner history information
    model = ifcopenshell.api.project.create_file(version=schema_version)

# Header
# Description
fd = model.header.file_description
fd.description = ("ViewDefinition [CoordinationViewV2.0]",)
fd.implementation_level = "2;1"

# Name
fn = model.header.file_name
fn.name = name
fn.time_stamp = datetime.utcnow().strftime('%Y-%m-%d %H:%M:%S')
fn.author = [author_name + " " + author_surname]
fn.organization = [organization]
fn.preprocessor_version = "ifcopenshell 0.8.3"
fn.originating_system = "IfcHopperShell 0.1.1"
fn.authorization = authorization

# Save model
model_out = model
# ---------- end ifcmodel ----------
ifcread = Python3Script()  # -> model_out, schema_version; inputs file_path: String
#   port file_path: The full file path ending in ".ifc".
#   port model_out: The IfcOpenShell model.
#   port schema_version: The version of IFC.
# ---------- ifcread: Python ----------
import ifcopenshell.api.root
import Grasshopper.Kernel as gh

# Shortcut aliases for Grasshopper runtime message levels
e = gh.GH_RuntimeMessageLevel.Error
w = gh.GH_RuntimeMessageLevel.Warning

# Initialize model
model = ifcopenshell.open(file_path)

schema_version = model.schema

# Save model
model_out = model
# ---------- end ifcread ----------
ifcwrite = Python3Script()  # -> out_path; inputs folder: String, file_name: String, write: Boolean
#   port model_in: The IfcOpenShell model.
#   port folder: The folder where to save the file. (Default is an "IfcHopperShell" folder in the user root)
#   port file_name: The file name. (Default is "Hopper File")
#   port write: A boolean to trigger file write. Use a button. (Default is False)
#   port out_path: The full path where the file is saved to.
# ---------- ifcwrite: Python ----------
import ifcopenshell
from pathlib import Path

# Set default values
if folder == None:
    folder = str(Path.home() / "IfcHopperShell") + "\\"

if file_name == None:
    file_name = "Hopper File"

if write == None:
    write = False

# Set out path
out_path = folder + file_name + ".ifc"

# Write file
if write:
    model_in.write(out_path)
# ---------- end ifcwrite ----------
ifcgetmesh = Python3Script()  # -> mesh, colors, step_id, pset_id, qto_id; inputs include: list of String, exclude: list of String
#   port model_in: The IfcOpenShell model.
#   port include: A list of ifc classes to include in the query (other will be excluded).
#   port exclude: A list of ifc classes to exclude from the query (others will be included).
#   port mesh: The meshes found in the model.
#   port colors: The colors assigned to the meshes.
#   port step_id: The step id of the related objects.
#   port pset_id: The ids of the associated Psets.
#   port qto_id: The ids of the associated Qtos.
# ---------- ifcgetmesh: Python ----------
import multiprocessing
import ifcopenshell.api.root
import System.Drawing as sd
import Rhino
import ghpythonlib.treehelpers as th
import math

# Initialize model
model = ifcopenshell.file.from_string(model_in.to_string())

# Lists for storing output geometry and property sets
mesh = []
colors = []
step_id = []
pset_id_list = []
qto_id_list = []

# Configure geometry extraction settings and iterator for the IFC file
settings = ifcopenshell.geom.settings()
iterator = None
if include != None and len(include) > 0:
    iterator = ifcopenshell.geom.iterator(settings, model, multiprocessing.cpu_count(), include=include)
elif exclude != None and len(exclude) > 0:
    iterator = ifcopenshell.geom.iterator(settings, model, multiprocessing.cpu_count(), exclude=exclude)
else:
    iterator = ifcopenshell.geom.iterator(settings, model, multiprocessing.cpu_count())

# Iterate over all shapes in the IFC file
if iterator.initialize():
    while True:

        # Get the current shape (geometry chunk)
        shape = iterator.get()

        # Get transformation matrix
        matrix = ifcopenshell.util.shape.get_shape_matrix(shape)

        # Get materials
        materials = shape.geometry.materials
        alpha = 255
        if not math.isnan(materials[0].transparency):
            alpha = (1 - materials[0].transparency) * 255

        color = sd.Color.FromArgb(alpha, materials[0].diffuse.r()*255, materials[0].diffuse.g()*255, materials[0].diffuse.b()*255)

        colors.append(color)

        # Get grouped vertices and faces (as arrays)
        grouped_verts = ifcopenshell.util.shape.get_vertices(shape.geometry)
        grouped_faces = ifcopenshell.util.shape.get_faces(shape.geometry)
        
        # Mesh
        element_mesh = Rhino.Geometry.Mesh()

        vertices = []
        for vertex in grouped_verts:
            vertices.append(Rhino.Geometry.Point3d(vertex[0], vertex[1], vertex[2]))
            element_mesh.Vertices.Add(vertex[0], vertex[1], vertex[2])

        for face in grouped_faces:
            if len(face) == 3:
                element_mesh.Faces.AddFace(int(face[0]), int(face[1]), int(face[2]))
            elif len(face) == 4:
                element_mesh.Faces.AddFace(int(face[0]), int(face[1]), int(face[2]), int(face[3]))

        # Prepare Rhino transformation matrix
        rtsmatrix = Rhino.Geometry.Transform(1.0)

        rtsmatrix.M00 = matrix[0][0]
        rtsmatrix.M01 = matrix[0][1]
        rtsmatrix.M02 = matrix[0][2]
        rtsmatrix.M03 = matrix[0][3]
        rtsmatrix.M10 = matrix[1][0]
        rtsmatrix.M11 = matrix[1][1]
        rtsmatrix.M12 = matrix[1][2]
        rtsmatrix.M13 = matrix[1][3]
        rtsmatrix.M20 = matrix[2][0]
        rtsmatrix.M21 = matrix[2][1]
        rtsmatrix.M22 = matrix[2][2]
        rtsmatrix.M23 = matrix[2][3]
        rtsmatrix.M30 = matrix[3][0]
        rtsmatrix.M31 = matrix[3][1]
        rtsmatrix.M32 = matrix[3][2]
        rtsmatrix.M33 = matrix[3][3]

        element_mesh.Normals.ComputeNormals()
        element_mesh.Compact()
        element_mesh.Unweld(0, True)
        #mesh.Weld(Rhino.RhinoMath.ToRadians(90))

        element_mesh.Transform(rtsmatrix)

        # Append geometry and property set info for output
        mesh.append(element_mesh)

        # Retrieve the IFC element by its ID
        step_id.append(shape.id)

        element = model.by_id(shape.id)

        # Get Psets
        element_pset = []
        for pset in list(ifcopenshell.util.element.get_psets(element, psets_only=True)):
            element_pset.append(ifcopenshell.util.element.get_psets(element)[pset]["id"])

        # Get Qtos
        element_qto = []
        for qto in list(ifcopenshell.util.element.get_psets(element, qtos_only=True)):
            element_qto.append(ifcopenshell.util.element.get_psets(element)[qto]["id"])
    
        pset_id_list.append(element_pset)
        qto_id_list.append(element_qto)

        # Move to next shape in iterator
        if not iterator.next():
            break

pset_id = th.list_to_tree(pset_id_list)
qto_id = th.list_to_tree(qto_id_list)
# ---------- end ifcgetmesh ----------

# ----
# 2 - Space
ifcproject = Python3Script()  # -> model_out, project_id; inputs name: String
#   port model_in: The IfcOpenShell model.
#   port name: The project name. (Default is Hopper Project)
#   port model_out: The IfcOpenShell model.
#   port project_id: The IFC project Id.
# ---------- ifcproject: Python ----------
import ifcopenshell.api.root
import ghpythonlib.treehelpers as th
import Grasshopper.Kernel as gh
import Rhino

# Shortcut aliases for Grasshopper runtime message levels
e = gh.GH_RuntimeMessageLevel.Error
w = gh.GH_RuntimeMessageLevel.Warning

# Set default values
if name == None:
    name = "Hopper Project"

length = None
area = None
volume = None

# Initialize model
model = ifcopenshell.file.from_string(model_in.to_string())

# Units
if (str(Rhino.RhinoDoc.ActiveDoc.ModelUnitSystem) == "Nanometers"):
    length = ifcopenshell.api.unit.add_si_unit(model, unit_type="LENGTHUNIT", prefix="NANO")
    area = ifcopenshell.api.unit.add_si_unit(model, unit_type="AREAUNIT", prefix="NANO")
    volume = ifcopenshell.api.unit.add_si_unit(model, unit_type="VOLUMEUNIT", prefix="NANO")

elif (str(Rhino.RhinoDoc.ActiveDoc.ModelUnitSystem) == "Microns"):
    length = ifcopenshell.api.unit.add_si_unit(model, unit_type="LENGTHUNIT", prefix="MICRO")
    area = ifcopenshell.api.unit.add_si_unit(model, unit_type="AREAUNIT", prefix="MICRO")
    volume = ifcopenshell.api.unit.add_si_unit(model, unit_type="VOLUMEUNIT", prefix="MICRO")

elif (str(Rhino.RhinoDoc.ActiveDoc.ModelUnitSystem) == "Millimeters"):
    length = ifcopenshell.api.unit.add_si_unit(model, unit_type="LENGTHUNIT", prefix="MILLI")
    area = ifcopenshell.api.unit.add_si_unit(model, unit_type="AREAUNIT", prefix="MILLI")
    volume = ifcopenshell.api.unit.add_si_unit(model, unit_type="VOLUMEUNIT", prefix="MILLI")

elif (str(Rhino.RhinoDoc.ActiveDoc.ModelUnitSystem) == "Centimeters"):
    length = ifcopenshell.api.unit.add_si_unit(model, unit_type="LENGTHUNIT", prefix="CENTI")
    area = ifcopenshell.api.unit.add_si_unit(model, unit_type="AREAUNIT", prefix="CENTI")
    volume = ifcopenshell.api.unit.add_si_unit(model, unit_type="VOLUMEUNIT", prefix="CENTI")

elif (str(Rhino.RhinoDoc.ActiveDoc.ModelUnitSystem) == "Decimeters"):
    length = ifcopenshell.api.unit.add_si_unit(model, unit_type="LENGTHUNIT", prefix="DECI")
    area = ifcopenshell.api.unit.add_si_unit(model, unit_type="AREAUNIT", prefix="DECI")
    volume = ifcopenshell.api.unit.add_si_unit(model, unit_type="VOLUMEUNIT", prefix="DECI")

elif (str(Rhino.RhinoDoc.ActiveDoc.ModelUnitSystem) == "Meters"):
    length = ifcopenshell.api.unit.add_si_unit(model, unit_type="LENGTHUNIT")
    area = ifcopenshell.api.unit.add_si_unit(model, unit_type="AREAUNIT")
    volume = ifcopenshell.api.unit.add_si_unit(model, unit_type="VOLUMEUNIT")

elif (str(Rhino.RhinoDoc.ActiveDoc.ModelUnitSystem) == "Dekameters"):
    length = ifcopenshell.api.unit.add_si_unit(model, unit_type="LENGTHUNIT", prefix="DECA")
    area = ifcopenshell.api.unit.add_si_unit(model, unit_type="AREAUNIT", prefix="DECA")
    volume = ifcopenshell.api.unit.add_si_unit(model, unit_type="VOLUMEUNIT", prefix="DECA")

elif (str(Rhino.RhinoDoc.ActiveDoc.ModelUnitSystem) == "Hectometers"):
    length = ifcopenshell.api.unit.add_si_unit(model, unit_type="LENGTHUNIT", prefix="HECTO")
    area = ifcopenshell.api.unit.add_si_unit(model, unit_type="AREAUNIT", prefix="HECTO")
    volume = ifcopenshell.api.unit.add_si_unit(model, unit_type="VOLUMEUNIT", prefix="HECTO")

elif (str(Rhino.RhinoDoc.ActiveDoc.ModelUnitSystem) == "Kilometers"):
    length = ifcopenshell.api.unit.add_si_unit(model, unit_type="LENGTHUNIT", prefix="KILO")
    area = ifcopenshell.api.unit.add_si_unit(model, unit_type="AREAUNIT", prefix="KILO")
    volume = ifcopenshell.api.unit.add_si_unit(model, unit_type="VOLUMEUNIT", prefix="KILO")

elif (str(Rhino.RhinoDoc.ActiveDoc.ModelUnitSystem) == "Megameters"):
    length = ifcopenshell.api.unit.add_si_unit(model, unit_type="LENGTHUNIT", prefix="MEGA")
    area = ifcopenshell.api.unit.add_si_unit(model, unit_type="AREAUNIT", prefix="MEGA")
    volume = ifcopenshell.api.unit.add_si_unit(model, unit_type="VOLUMEUNIT", prefix="MEGA")

elif (str(Rhino.RhinoDoc.ActiveDoc.ModelUnitSystem) == "Gigameters"):
    length = ifcopenshell.api.unit.add_si_unit(model, unit_type="LENGTHUNIT", prefix="GIGA")
    area = ifcopenshell.api.unit.add_si_unit(model, unit_type="AREAUNIT", prefix="GIGA")
    volume = ifcopenshell.api.unit.add_si_unit(model, unit_type="VOLUMEUNIT", prefix="GIGA")

else:
    # If the units is not one of the above, assume the model is in meters and warn the user
    length = ifcopenshell.api.unit.add_si_unit(model, unit_type="LENGTHUNIT")
    area = ifcopenshell.api.unit.add_si_unit(model, unit_type="AREAUNIT")
    volume = ifcopenshell.api.unit.add_si_unit(model, unit_type="VOLUMEUNIT")
    
    warning_message = """Unsupported model unit. Assuming Meters.
    
    Supported units are:
     - Nanometers
     - Microns
     - Millimeters
     - Centimeters
     - Decimeters
     - Meters
     - Dekameters
     - Hectometers
     - Kilometers
     - Megameters
     - Gigameters"""
    ghenv.Component.AddRuntimeMessage(w, warning_message)

# Create project
project = ifcopenshell.api.root.create_entity(model, ifc_class="IfcProject", name=name)
ifcopenshell.api.unit.assign_unit(model, units=[length, area, volume])
project_id = project.id()

# Save model
model_out = model
# ---------- end ifcproject ----------
ifcsite = Python3Script(model_in="IfcProject")  # -> model_out, site_id; inputs relating_object_id: Int32, name: list
#   port model_in: The IfcOpenShell model.
#   port relating_object_id: The relating object ID, usually a project ID.
#   port name: A list of site names. (Default is "Hopper Site")
#   port model_out: The IfcOpenShell model.
#   port site_id: The IFC site Id.
# ---------- ifcsite: Python ----------
import ifcopenshell.api.root

# Set default values
if name == None:
    name = ["Hopper Site"]

# Initialize model
model = ifcopenshell.file.from_string(model_in.to_string())

# Initalize empty array
site_id = []

# Create sites (one per name)
for i in range(len(name)):
    site = ifcopenshell.api.root.create_entity(model, ifc_class="IfcSite", name=name[i])
    relating_object = model.by_id(relating_object_id)
    ifcopenshell.api.aggregate.assign_object(model, relating_object=relating_object, products=[site])

    site_id.append(int(site.id()))

# Save model
model_out = model
# ---------- end ifcsite ----------
ifccontext = Python3Script()  # -> model_out, context_id
#   port model_in: The IfcOpenShell model.
#   port context_type: "Model" if you are working in 3d or "Plan" if you are working in 2d. (Default is "Model")
#   port context_identifier: The “Identifier” describes the purpose of the representation. Can be: - "Body": for the actual shape of the object - "Box": the bounding box of the object - "Axis": the parametric line determining the shape of the object - "Profile": the elevation slihouette of the object - "Footprint": the plan view silhouette of the object - "Clearance": the clearance zone of the object. - "Annotation": symbolic annotations typically used in diagrams or drawings (Default is "Body")
#   port target_view: The "Target View” describes the typical diagrammatic presentation that context’s geometry should be viewed in. Can be: - "MODEL_VIEW": for 3D geometry you might see in a BIM viewer - "PLAN_VIEW": for 2D geometry you might see in a plan representation - "ELEVATION_VIEW": for 2D geometry you might see in an elevation representation - "SECTION_VIEW": for 2D geometry you might see in a section representation - "GRAPH_VIEW": for 2D or 3D line or frame or path connectivity diagrams you might use for structural frame analysis, axis-based parametric modeling - "SKETCH_VIEW": for viewing abstract high-level representations such as in bubble diagrams of spatial topology (Default is "MODEL_VIEW")
#   port parent_context_id: If this is a subcontext, a parent context id should be provided.
#   port model_out: The IfcOpenShell model.
#   port context_id: The IFC context Id.
# ---------- ifccontext: Python ----------
import ifcopenshell.api.root

# Set default values
if context_type == None:
    context_type = "Model"

if context_identifier == None:
    context_identifier = "Body"

if target_view == None:
    target_view = "MODEL_VIEW"

# Initialize model
model = ifcopenshell.file.from_string(model_in.to_string())

# Subcotext
if parent_context_id != None:
    parent = model.by_id(parent_context_id)
    context = ifcopenshell.api.context.add_context(model, context_type=context_type,
        context_identifier=context_identifier, target_view=target_view, parent=parent)

# Context
else:
    context = ifcopenshell.api.context.add_context(model, context_type=context_type,
        context_identifier=context_identifier, target_view=target_view)

context_id = context.id()

# Save model
model_out = model
# ---------- end ifccontext ----------
ifcgeoreference = Python3Script()  # -> model_out, context_id; inputs projected_crs: Int32, eastings: Double, northings: Double, north_angle: Double, origin_scale: Double
#   port model_in: The IfcOpenShell model.
#   port projected_crs: The EPSG code for the projection. (Default is 4326)
#   port eastings: The longitude of the project. (Default is 0.0)
#   port northings: The latitude of the project origin. (Default is 0.0)
#   port north_angle: The angle between the project and world north, counterclockwise is positive. (Default is 0.0)
#   port origin_scale: The scale at the origin. (Dafault is 1.0)
#   port model_out: The IfcOpenShell model.
#   port context_id: Georeferencing is assigned to a context, this is the Id of that context.
# ---------- ifcgeoreference: Python ----------
import ifcopenshell.api.root
import ifcopenshell.api.georeference
import math
import Grasshopper.Kernel as gh

# Shortcut aliases for Grasshopper runtime message levels
e = gh.GH_RuntimeMessageLevel.Error
w = gh.GH_RuntimeMessageLevel.Warning

# Set default values
if projected_crs == None:
    projected_crs = 4326

if eastings == None:
    eastings = 0.0

if northings == None:
    northings = 0.0

if north_angle == None:
    north_angle = 0.0

if origin_scale == None:
    origin_scale = 1.0

# Initialize model
model = ifcopenshell.file.from_string(model_in.to_string())

# Validate context
# Georeferencig is assigned to the first context of type "Model" found in the model

# if there is at least one, but it's not of type "Model", create it and warn the user
if (model.by_type("IfcGeometricRepresentationContext", include_subtypes=False)):
    context_list = model.by_type("IfcGeometricRepresentationContext", include_subtypes=False)

    for context in context_list:
        if (context.ContextType != "Model"):
            context = ifcopenshell.api.context.add_context(model, context_type="Model")
    
            ghenv.Component.AddRuntimeMessage(w, f"{len(context_list)} context have been found, but none of type \"Model\". A new one is added, be aware that some objects are probably associated to different contexts.")
        else:
            if (len(context_list) > 1):
                ghenv.Component.AddRuntimeMessage(w, f"{len(context_list)} context have been found. Note that georeferencing will be assigned to the first one only.")

                context = context_list[0]

# if there isn't one, create it and warn the user
else:
    context = ifcopenshell.api.context.add_context(model, context_type="Model")

    ghenv.Component.AddRuntimeMessage(w, "No context was found. A new one is added, be aware that some objects are probably associated to different contexts.")

context_id = context.id()

# Add georeferencing
ifcopenshell.api.georeference.add_georeferencing(model)

ifcopenshell.api.georeference.edit_georeferencing(model,
    projected_crs={"Name": "EPSG:" + str(projected_crs)},
    coordinate_operation={
        "Eastings": eastings, # False origin (horizontal)
        "Northings": northings, # False origin (vertical)
        "XAxisAbscissa": math.cos(math.radians(north_angle)), # Horizontal component of project north vector
        "XAxisOrdinate": math.sin(math.radians(north_angle)), # Vertical component of project north vector
        "Scale": origin_scale, # Scale factor at origin
    })

# Save model
model_out = model
# ---------- end ifcgeoreference ----------
ifcbuilding = Python3Script()  # -> model_out, building_id; inputs name: list
#   port model_in: The IfcOpenShell model.
#   port relating_object_id: The relating object id, usually an Ifc Site.
#   port name: A list of building names. (Default is "Hopper Building")
#   port model_out: The IfcOpenShell model.
#   port building_id: The IFC building Id.
# ---------- ifcbuilding: Python ----------
import ifcopenshell.api.root

# Set default values
if name == None:
    name = ["Hopper Building"]

# Intialize model
model = ifcopenshell.file.from_string(model_in.to_string())

# Initialize empty arrays
building_id = []

# Create buildings (one per name)
for i in range(len(name)):
    building = ifcopenshell.api.root.create_entity(model, ifc_class="IfcBuilding", name=name[i])
    relating_object = model.by_id(relating_object_id)
    ifcopenshell.api.aggregate.assign_object(model, relating_object=relating_object, products=[building])

    building_id.append(int(building.id()))

# Save model
model_out = model
# ---------- end ifcbuilding ----------
ifctunnel = Python3Script()  # -> model_out, tunnel_id; inputs name: list
#   port model_in: The IfcOpenShell model.
#   port relating_object_id: The relating object id, usually an Ifc Site.
#   port name: A list of tunnel names. (Default is "Hopper Tunnel")
#   port model_out: The IfcOpenShell model.
#   port tunnel_id: The IFC road Id.
# ---------- ifctunnel: Python ----------
import ifcopenshell.api.root
import Grasshopper.Kernel as gh

# Shortcut aliases for Grasshopper runtime message levels
e = gh.GH_RuntimeMessageLevel.Error
w = gh.GH_RuntimeMessageLevel.Warning

# Set default values
if name == None:
    name = ["Hopper Tunnel"]

# Initialize model
model = ifcopenshell.file.from_string(model_in.to_string())

# Initialize empty arrays
tunnel_id = []

# If model schema is IFC2X3 or IF4, replace Ifctunnel with IfcBuilding and warn user
ifc_class="IfcTunnel"
if (model.schema in ["IFC2X3", "IFC4"]):
    ghenv.Component.AddRuntimeMessage(w, f"\"Ifctunnel\" is not supported in schema {model.schema}, falling back to \"IfcBuilding\"")
    ifc_class="IfcBuilding"

# Create tunnels (one per name)
for i in range(len(name)):
    tunnel = ifcopenshell.api.root.create_entity(model, ifc_class=ifc_class, name=name[i])
    relating_object = model.by_id(relating_object_id)
    ifcopenshell.api.aggregate.assign_object(model, relating_object=relating_object, products=[tunnel])

    tunnel_id.append(int(tunnel.id()))

# Save model
model_out = model
# ---------- end ifctunnel ----------
ifcroad = Python3Script()  # -> model_out, road_id; inputs name: list
#   port model_in: The IfcOpenShell model.
#   port relating_object_id: The relating object id, usually an Ifc Site.
#   port name: A list of road names. (Default is "Hopper Road")
#   port model_out: The IfcOpenShell model.
#   port road_id: The IFC road Id.
# ---------- ifcroad: Python ----------
import ifcopenshell.api.root
import Grasshopper.Kernel as gh

# Shortcut aliases for Grasshopper runtime message levels
e = gh.GH_RuntimeMessageLevel.Error
w = gh.GH_RuntimeMessageLevel.Warning

# Set default values
if name == None:
    name = ["Hopper Road"]

# Initialize model
model = ifcopenshell.file.from_string(model_in.to_string())

# Initialize empty arrays
road_id = []

# If model schema is IFC2X3 or IF4, replace IfcRoad with IfcBuilding and warn user
ifc_class="IfcRoad"
if (model.schema in ["IFC2X3", "IFC4"]):
    ghenv.Component.AddRuntimeMessage(w, f"\"IfcRoad\" is not supported in schema {model.schema}, falling back to \"IfcBuilding\"")
    ifc_class="IfcBuilding"

# Create roads (one per name)
for i in range(len(name)):
    road = ifcopenshell.api.root.create_entity(model, ifc_class=ifc_class, name=name[i])
    relating_object = model.by_id(relating_object_id)
    ifcopenshell.api.aggregate.assign_object(model, relating_object=relating_object, products=[road])

    road_id.append(int(road.id()))

# Save model
model_out = model
# ---------- end ifcroad ----------
ifcbuildingstorey = Python3Script()  # -> model_out, storey_id; inputs name: list
#   port model_in: The IfcOpenShell model.
#   port relating_object_id: The relating object id, usually an Ifc Building.
#   port name: A list of storey names. (Default is "Hopper Storey")
#   port model_out: The IfcOpenShell model.
#   port storey_id: The IFC storey Id.
# ---------- ifcbuildingstorey: Python ----------
import ifcopenshell.api.root

# Set default values
if name == None:
    name = ["Hopper Storey"]

# Intialize model
model = ifcopenshell.file.from_string(model_in.to_string())

# Initialize empty arrays
storey_id = []

# Create buildings (one per name)
for i in range(len(name)):
    storey = ifcopenshell.api.root.create_entity(model, ifc_class="IfcBuildingStorey", name=name[i])
    relating_object = model.by_id(relating_object_id)
    ifcopenshell.api.aggregate.assign_object(model, relating_object=relating_object, products=[storey])

    storey_id.append(int(storey.id()))

# Save model
model_out = model
# ---------- end ifcbuildingstorey ----------

# ----
# 3 - Object
ifcobject = Python3Script()  # -> model_out, object_id; inputs name: tree of String, relating_object_id: tree of Int32, context_id: tree of Int32, ifc_class: tree of String, mesh: tree of Mesh, style_id: tree of Int32
#   port model_in: The IfcOpenShell model.
#   port name: A tree of names. (Default is "Hopper Object")
#   port relating_object_id: A list of relating object ids, usually the storey, the building, the road etc.
#   port context_id: A list of context ids.
#   port ifc_class: A list of Ifc Classes. (Default is "IfcBuildingElementProxy")
#   port mesh: A list of meshes that make up the representation of this object. Note: a mesh is not required, an object can exist without a geometric reperesentation.
#   port style_id: The style id to use.
#   port model_out: The IfcOpenShell model.
#   port object_id: The IFC object Id.
# ---------- ifcobject: Python ----------
import rhinoscriptsyntax as rs
import ifcopenshell.api.root
import Grasshopper.Kernel as gh
import Rhino.Geometry as rg
from Grasshopper import DataTree
import ghpythonlib.treehelpers as th

def have_trees_same_shape(tree1, tree2):
    """
    Compares two Grasshopper Data Trees to check if they have the same set of 
    branch paths AND the same number of items in each corresponding branch.
    
    Args:
        tree1 (GH_Structure): The first Data Tree.
        tree2 (GH_Structure): The second Data Tree.
        
    Returns:
        bool: True if both shape and counts are identical, False otherwise.
    """
    
    # 1. Check Path Count
    if tree1.BranchCount != tree2.BranchCount:
        return False

    # 2. Get and sort the paths for consistent iteration
    # We convert to string and sort to ensure we check the correct corresponding paths.
    paths_A = sorted([path.ToString() for path in tree1.Paths])
    paths_B = sorted([path.ToString() for path in tree2.Paths])

    # If the sorted path names are different, the shapes are not identical.
    if paths_A != paths_B:
        return False
        
    # 3. Check Element Counts for each branch
    # Since paths_A and paths_B are sorted and equal, we can iterate simultaneously.
    for path_str in paths_A:
        
        # Convert the string path back to a GH_Path object to access the branch data
        # Note: We can simplify this by using the original tree1.Paths and tree2.Paths 
        # and checking the counts while iterating, but converting to strings first 
        # guarantees a paired iteration. A dictionary lookup is cleaner.
        
        # A simpler way is to build a dictionary of {path_string: count}
        
        # Build dictionaries of {PathString: BranchItemCount}
        branch_map_A = {p.ToString(): tree1.Branch(p).Count for p in tree1.Paths}
        branch_map_B = {p.ToString(): tree2.Branch(p).Count for p in tree2.Paths}
        
        # Compare the counts using the path string as the key
        if branch_map_A[path_str] != branch_map_B[path_str]:
            # The count of items in this specific branch is different
            return False

    # If all paths matched and all corresponding branch counts matched, they are identical in structure
    return True

def isinstance_tree(data_tree, expected_type):
    """
    Checks every single element in a Grasshopper DataTree against a specified Python type.

    Args:
        data_tree (GH_Structure): The input Data Tree.
        expected_type (type): The target Python type (e.g., int, float, str).

    Returns:
        bool: True if every element is of the expected type, False otherwise.
    """
    
    # 1. Iterate through all the paths (branches) in the tree
    for path in data_tree.Paths:
        # 2. Get the list of items for the current branch
        branch_data = data_tree.Branch(path)
        
        # Handle the case of empty branches (they don't violate the type constraint)
        if not branch_data:
            continue
            
        # 3. Iterate through every item in the current branch
        for item in branch_data:
            # 4. Perform the type check
            if not isinstance(item, expected_type):
                # If any item fails the check, we can stop immediately and return False
                return False

    # 5. If the loops complete without returning False, all elements matched the type
    return True

# Shortcut aliases for Grasshopper runtime message levels
e = gh.GH_RuntimeMessageLevel.Error
w = gh.GH_RuntimeMessageLevel.Warning

# Set default values
# Relating Object Id
# If it does not have the same shape of name
if not have_trees_same_shape(name, relating_object_id):

    # if it only has one element
    if relating_object_id.BranchCount == 1 and len(relating_object_id.Branch(relating_object_id.Paths[0])) == 1:

        # Use the first element
        first_element = relating_object_id.Branch(relating_object_id.Paths[0])[0]

        relating_object_id = DataTree[object]()

        for path in name.Paths:
            original_branch_data = name.Branch(path)
            new_data = [first_element] * len(original_branch_data)
            relating_object_id.AddRange(new_data, path)
    else:
        
        # Use the first element
        first_element = relating_object_id.Branch(relating_object_id.Paths[0])[0]

        relating_object_id = DataTree[object]()

        for path in name.Paths:
            original_branch_data = name.Branch(path)
            new_data = [first_element] * len(original_branch_data)
            relating_object_id.AddRange(new_data, path)

        # And warn the user
        ghenv.Component.AddRuntimeMessage(w, "Relating Object Id can either contain one element or have the same shape of the Name tree.")

# Context Id
# If it does not have the same shape of name
if not have_trees_same_shape(name, context_id):

    # if it only has one element
    if context_id.BranchCount == 1 and len(context_id.Branch(context_id.Paths[0])) == 1:

        # Use the first element
        first_element = context_id.Branch(context_id.Paths[0])[0]

        context_id = DataTree[object]()

        for path in name.Paths:
            original_branch_data = name.Branch(path)
            new_data = [first_element] * len(original_branch_data)
            context_id.AddRange(new_data, path)
    else:
        
        # Use the first element
        first_element = context_id.Branch(context_id.Paths[0])[0]

        context_id = DataTree[object]()

        for path in name.Paths:
            original_branch_data = name.Branch(path)
            new_data = [first_element] * len(original_branch_data)
            context_id.AddRange(new_data, path)

        # And warn the user
        ghenv.Component.AddRuntimeMessage(w, "Context Id can either contain one element or have the same shape of the Name tree.")

# Class
# If it's empty or does not have the same shape of name
if ifc_class.BranchCount == 0 or not have_trees_same_shape(name, ifc_class):
    
    # If it't not empty warn the user
    if (ifc_class.BranchCount != 0):
        ghenv.Component.AddRuntimeMessage(w, "Class can either be empty or the same shape of the Name tree.\nThe default \"IfcBuildingElementProxy\" will be used for all objects.")

    # In any case ignore the malformed input and set it to "IfcBuildingElementProxy"
    ifc_class = DataTree[object]()

    for path in name.Paths:
        original_branch_data = name.Branch(path)
        new_data = ["IfcBuildingElementProxy"] * len(original_branch_data)
        ifc_class.AddRange(new_data, path)

# Mesh
# If it's empty or does not have the same shape of name
if mesh.BranchCount == 0 or not have_trees_same_shape(name, mesh):

    # If it's not empty warn the user
    if (mesh.BranchCount != 0):
        ghenv.Component.AddRuntimeMessage(w, "Mesh can either be empty or the same shape of the Name tree.\nObjects will have no mesh.")

    # In any case ignore the malformed input and set it to None
    mesh = DataTree[object]()

    for path in name.Paths:
        original_branch_data = name.Branch(path)
        new_data = [None] * len(original_branch_data)
        mesh.AddRange(new_data, path)

# Style
# If it's empty
if style_id.BranchCount == 0:
    style_id = DataTree[object]()

    for path in name.Paths:
        original_branch_data = name.Branch(path)
        new_data = [None] * len(original_branch_data)
        style_id.AddRange(new_data, path)

# If it does not have the same shape of name
if not have_trees_same_shape(name, style_id):

    # if it only has one element
    if style_id.BranchCount == 1 and len(style_id.Branch(style_id.Paths[0])) == 1:

        # Use the first element
        first_element = style_id.Branch(style_id.Paths[0])[0]

        style_id = DataTree[object]()

        for path in name.Paths:
            original_branch_data = name.Branch(path)
            new_data = [first_element] * len(original_branch_data)
            style_id.AddRange(new_data, path)
    else:
        
        # Use the first element
        first_element = style_id.Branch(style_id.Paths[0])[0]

        style_id = DataTree[object]()

        for path in name.Paths:
            original_branch_data = name.Branch(path)
            new_data = [first_element] * len(original_branch_data)
            style_id.AddRange(new_data, path)

        # And warn the user
        ghenv.Component.AddRuntimeMessage(w, "Style Id can either contain one element or have the same shape of the Name tree.")

# Initialize model
model = ifcopenshell.file.from_string(model_in.to_string())

# Initialize empty arrays
object_id_list = []

# Create objects
for i in range(len(name.Paths)):
    name_branch = name.Branch(name.Paths[i])
    relating_object_id_branch = relating_object_id.Branch(name.Paths[i])
    context_id_branch = context_id.Branch(name.Paths[i])
    ifc_class_branch = ifc_class.Branch(name.Paths[i])
    mesh_branch = mesh.Branch(name.Paths[i])
    style_id_branch = style_id.Branch(name.Paths[i])

    object_id_list.append([])

    for j in range(len(name_branch)):

        # Get spatial structure and context
        relating_object = model.by_id(relating_object_id_branch[j])
        context = model.by_id(context_id_branch[j])

        # Create entity
        ifc_object = ifcopenshell.api.root.create_entity(model, ifc_class=ifc_class_branch[j], name=name_branch[j] )
        ifcopenshell.api.geometry.edit_object_placement(model, product=ifc_object)

        # Relating object
        ifcopenshell.api.aggregate.assign_object(model, relating_object=relating_object, products=[ifc_object])

        object_id_list[i].append(ifc_object.id())

        # If there is a mesh
        if(mesh_branch[j]):

            vertices = []
            faces = []

            # Get vertex positions
            # for vertex in list(mesh_branch[j].Vertices):
            #     vertices.append((vertex.X, vertex.Y, vertex.Z))
            vertices = [(vertex.X, vertex.Y, vertex.Z) for vertex in mesh_branch[j].Vertices]

            # Build quad or tri faces
            for face in list(mesh_branch[j].Faces):
                if face.IsTriangle:
                    faces.append((face.A, face.B, face.C))
                else:
                    faces.append((face.A, face.B, face.C,face.D))

            # Geometric representation
            representation = ifcopenshell.api.geometry.add_mesh_representation(model, context=context, vertices=[vertices], faces=[faces])
            ifcopenshell.api.geometry.assign_representation(model, product=ifc_object, representation=representation)

            # Style representation
            if (style_id_branch[j] != None):
                style = model.by_id(style_id_branch[j])
                ifcopenshell.api.style.assign_representation_styles(model, shape_representation=representation, styles=[style])

object_id = th.list_to_tree(object_id_list)

# Save model
model_out = model
# ---------- end ifcobject ----------
ifcqto = Python3Script()  # -> model_out, qto_id; inputs ifc_object_id: list, quantity_type: list of String, keys: list, values: tree
#   port model_in: The IfcOpenShell model.
#   port name: The name of the Qto. (Default is "Hopper Qto")
#   port ifc_object_id: A list of object ids to assign the Pset to.
#   port quantity_type: A type. Can be: - "Number" - "Count" - "Length" - "Area" - "Volume" - "Time" (Default is "Length")
#   port keys: A list of keys.
#   port values: A tree of values, one branch per object.
#   port model_out: The IfcOpenShell model.
#   port qto_id: The IFC Qto Id.
# ---------- ifcqto: Python ----------
import ifcopenshell.api.root
import ghpythonlib.treehelpers as th
import Grasshopper.Kernel as gh

# Shortcut aliases for Grasshopper runtime message levels
e = gh.GH_RuntimeMessageLevel.Error
w = gh.GH_RuntimeMessageLevel.Warning

# Set default values
if name == None:
    name = "Hopper Qto"

if keys != None:
    keys = [keys] * len(ifc_object_id)

if quantity_type == None:
    quantity_type = ["Length"] * len(ifc_object_id)

elif len(quantity_type) == 1:
    quantity_type = quantity_type * len(ifc_object_id)

# Initialize model
model = ifcopenshell.file.from_string(model_in.to_string())

# Initialize empty arrays
products = []
qtos = []
qto_id = []

values_list = []

properties_list = []

# Validate values
if keys != None and values.BranchCount != 0:
    values_list = th.tree_to_list(values)
    
    if values.BranchCount == 1:
        values_list = [values_list] * len(ifc_object_id)

    elif values.BranchCount != len(ifc_object_id):
        ghenv.Component.AddRuntimeMessage(w, "Values tree branch count must be one, or match the length of the Ifc Object Id array.")

    for value in values_list:
        if len(value) != len(keys[0]):
            ghenv.Component.AddRuntimeMessage(w, "The number of values has to match the number of keys, for each branch.")

# Create Qto, associate properties and objects
for object_index in range(len(ifc_object_id)):

    # Get object
    products.append( model.by_id(ifc_object_id[object_index]) )

    # Add Qto
    qtos.append( ifcopenshell.api.pset.add_qto(model, product=products[object_index], name=name) )

    # Add properties to Qto
    if keys != None:
        properties_list.append({})

        # values is a tree with a number of branches that matches the number of objetcs and a number of leafs that match the number of keys
        
        for i in range(len(keys[0])):
            if len(values_list) > 0:

                if quantity_type[i] == "Length":
                    properties_list[object_index][keys[object_index][i]] = model.createIfcLengthMeasure(values_list[object_index][i])

                elif quantity_type[i] == "Numeric":
                    properties_list[object_index][keys[object_index][i]] = model.createIfcNumericMeasure(values_list[object_index][i])

                elif quantity_type[i] == "Area":
                    properties_list[object_index][keys[object_index][i]] = model.createIfcAreaMeasure(values_list[object_index][i])

                elif quantity_type[i] == "Volume":
                    properties_list[object_index][keys[object_index][i]] = model.createIfcVolumeMeasure(values_list[object_index][i])
                
                elif quantity_type[i] == "Count":
                    properties_list[object_index][keys[object_index][i]] = model.createIfcCountMeasure(values_list[object_index][i])

                elif quantity_type[i] == "Time":
                    properties_list[object_index][keys[object_index][i]] = model.createIfcTimeMeasure(values_list[object_index][i])

            else:
                properties_list[object_index][keys[object_index][i]] = None

        print(properties_list[object_index])
        ifcopenshell.api.pset.edit_qto(model, qto=qtos[object_index], properties=properties_list[object_index])

    qto_id.append(int(qtos[object_index].id()))

# Save model
model_out = model
# ---------- end ifcqto ----------
ifcpset = Python3Script()  # -> model_out, pset_id; inputs ifc_object_id: list of Int32, keys: list of String, values: tree of String
#   port model_in: The IfcOpenShell model.
#   port name: The name of the Pset. (Default is "Hopper Pset")
#   port ifc_object_id: A list of object ids to assign the Pset to.
#   port keys: A list of keys.
#   port values: A tree of values, one branch per object.
#   port model_out: The IfcOpenShell model.
#   port pset_id: The IFC Pset Id.
# ---------- ifcpset: Python ----------
import ifcopenshell.api.root
import ghpythonlib.treehelpers as th
import Grasshopper.Kernel as gh

# Shortcut aliases for Grasshopper runtime message levels
e = gh.GH_RuntimeMessageLevel.Error
w = gh.GH_RuntimeMessageLevel.Warning

# Set default values
if name == None:
    name = "Hopper Pset"

if keys != None:
    keys = [keys] * len(ifc_object_id)

# Initialize model
model = ifcopenshell.file.from_string(model_in.to_string())

# Initialize empty arrays
products = []
psets = []
pset_id = []

values_list = []

properties_list = []

# Validate values
if keys != None and values.BranchCount != 0:
    values_list = th.tree_to_list(values)
    
    if values.BranchCount == 1:
        values_list = [values_list] * len(ifc_object_id)

    elif values.BranchCount != len(ifc_object_id):
        ghenv.Component.AddRuntimeMessage(w, "Values tree branch count must be one, or match the length of the Ifc Object Id array.")

    for value in values_list:
        if len(value) != len(keys[0]):
            ghenv.Component.AddRuntimeMessage(w, "The number of values has to match the number of keys, for each branch.")

# Create Pset, associate properties and objects
for object_index in range(len(ifc_object_id)):

    # Get object
    products.append( model.by_id(ifc_object_id[object_index]) )

    # Add Pset
    psets.append( ifcopenshell.api.pset.add_pset(model, product=products[object_index], name=name) )

    # Add properties to Pset
    if keys != None and values.BranchCount != 0:
        properties_list.append({})

        # values is a tree with a number of branches that matches the number of objetcs and a number of leafs that match the number of keys
        for i in range(len(keys[0])):
            properties_list[object_index][keys[object_index][i]] = values_list[object_index][i]

        ifcopenshell.api.pset.edit_pset(model, pset=psets[object_index], properties=properties_list[object_index])

    pset_id.append(int(psets[object_index].id()))

# Save model
model_out = model
# ---------- end ifcpset ----------
ifcstyle = Python3Script()  # -> model_out, style_id; inputs color: list of Color, name: list of String
#   port model_in: The IfcOpenShell model.
#   port color: A list of colors.
#   port name: A list of names for the styles. (Default is "Hopper Style")
#   port model_out: The IfcOpenShell model.
#   port style_id: The IFC style id.
# ---------- ifcstyle: Python ----------
import ifcopenshell.api.root

# Set default values
if name == None:
    name = ["Hopper Style"] * len(color)

# Initialize model
model = ifcopenshell.file.from_string(model_in.to_string())

# Initalize empty array
style_id = []

# Create sites (one per name)
for i in range(len(name)):
    style = ifcopenshell.api.style.add_style(model)

    surface_style = ifcopenshell.api.style.add_surface_style(model,
                    style=style,
                    attributes={
                        "SurfaceColour": { "Name": name[i], "Red": color[i].R/255, "Green": color[i].G/255, "Blue": color[i].B/255 },
                        "Transparency": (255 - color[i].A)/255, # 0 is opaque, 1 is transparent
                    })

    style_id.append(int(style.id()))

# Save model
model_out = model
# ---------- end ifcstyle ----------

# ----
# 4 - Utilities
ifcgetinfobyid = Python3Script()  # -> keys, values; inputs step_id: list of Int32
#   port model_in: The IfcOpenShell model.
#   port step_id: The Id of the object to get the info from.
# ---------- ifcgetinfobyid: Python ----------
import ifcopenshell.api.root
import ghpythonlib.treehelpers as th
import Grasshopper.Kernel as gh

# Shortcut aliases for Grasshopper runtime message levels
e = gh.GH_RuntimeMessageLevel.Error
w = gh.GH_RuntimeMessageLevel.Warning

# Initialize model
model = ifcopenshell.file.from_string(model_in.to_string())

# Initialize empty arrays
ifc_objects = []

keys_list = []
values_list = []

for s_id in step_id:
    try:
        object_info = model.by_id(s_id).get_info()
        keys_list.append(list(object_info.keys()))
        values_list.append(list(object_info.values()))
    except:
        ghenv.Component.AddRuntimeMessage(w, f"No object was found with Id {s_id}")

keys = th.list_to_tree(keys_list)
values = th.list_to_tree(values_list)
# ---------- end ifcgetinfobyid ----------
ifcgetinfobyguid = Python3Script()  # -> keys, values; inputs step_guid: list of String
#   port model_in: The IfcOpenShell model.
#   port step_guid: The Guid of the object to get the info from.
# ---------- ifcgetinfobyguid: Python ----------
import ifcopenshell.api.root
import ghpythonlib.treehelpers as th
import Grasshopper.Kernel as gh

# Shortcut aliases for Grasshopper runtime message levels
e = gh.GH_RuntimeMessageLevel.Error
w = gh.GH_RuntimeMessageLevel.Warning

# Initialize model
model = ifcopenshell.file.from_string(model_in.to_string())

# Initialize empty arrays
ifc_objects = []

keys_list = []
values_list = []

for s_guid in step_guid:
    try:
        object_info = model.by_id(s_guid).get_info()
        keys_list.append(list(object_info.keys()))
        values_list.append(list(object_info.values()))
    except:
        ghenv.Component.AddRuntimeMessage(w, f"No object was found with Id {s_guid}")

keys = th.list_to_tree(keys_list)
values = th.list_to_tree(values_list)
# ---------- end ifcgetinfobyguid ----------
ifcgetidbytype = Python3Script()  # -> step_id; inputs ifc_type: list of String
#   port model_in: The IfcOpenShell model.
#   port ifc_type: The Ifc type.
# ---------- ifcgetidbytype: Python ----------
import ifcopenshell.api.root
import ghpythonlib.treehelpers as th
import Grasshopper.Kernel as gh

# Shortcut aliases for Grasshopper runtime message levels
e = gh.GH_RuntimeMessageLevel.Error
w = gh.GH_RuntimeMessageLevel.Warning

# Initialize model
model = ifcopenshell.file.from_string(model_in.to_string())

# Initialize empty arrays
ifc_objects = []
id_list = []

for i_type in ifc_type:
    try:
        ifc_objects.append(model.by_type(i_type))
    except:
        ghenv.Component.AddRuntimeMessage(w, f"Type {i_type} not found in schema")

for i in range(len(ifc_objects)):

    if len(ifc_objects[i]) == 0:
        ghenv.Component.AddRuntimeMessage(w, f"No object of type {ifc_type[i]} was found")

    id_list.append([])

    for j in ifc_objects[i]:
        id_list[i].append(int(j.id()))

step_id = th.list_to_tree(id_list)
# ---------- end ifcgetidbytype ----------
