# Grasshopper definition Hopper_Script.gh (Grasshopper 1.0.8)
# plug-ins: IfcHopperShell.Components

ifc_model = IfcModel()
ifc_project = IfcProject(Model=ifc_model)  # -> Model, ProjectId
ifc_site = IfcSite(Model=ifc_project.Model, RelatingObjectId=ifc_project.ProjectId)  # -> Model, SiteId
ifc_context = IfcContext(Model=ifc_site.Model)  # -> Model, ContextId
ifc_context_2 = IfcContext(Model=ifc_context.Model, ParentId=ifc_context.ContextId)  # -> Model, ContextId
ifc_building = IfcBuilding(Model=ifc_context_2.Model, RelatingObjectId=ifc_site.SiteId)  # -> Model, BuildingId
panel = Panel("""Hopper Storey 1
Hopper Storey 2""")
ifc_building_storey = IfcBuildingStorey(Model=ifc_building.Model, RelatingObjectId=ifc_building.BuildingId, Name=panel)  # -> Model, StoreyId
list_item = ListItem(List=ifc_building_storey.StoreyId, Index=0, Wrap=True)
ifc_style = IfcStyle(Model=ifc_building_storey.Model, Color=ColourSwatch(SwatchColor=RGB(125, 201, 48)))  # -> Model, StyleId
mesh = Mesh(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)
ifc_object = IfcObject(
    Model=ifc_style.Model,
    Name="Hopper Object 1",
    RelatingObjectId=list_item,
    ContextId=ifc_context_2.ContextId,
    Mesh=mesh,
    StyleId=ifc_style.StyleId)  # -> Model, ObjectId
panel_2 = Panel("""Prop 1
Prop 2""")
panel_3 = Panel("""Hello
Hopper""")
ifc_pset = IfcPset(Model=ifc_object.Model, ObjectId=ifc_object.ObjectId, Keys=panel_2, Values=panel_3)  # -> Model, PsetId
area = Area(Geometry=mesh)  # -> Area, Centroid
ifc_qto = IfcQto(Model=ifc_pset.Model, ObjectId=ifc_object.ObjectId, QuantityType="Area", Keys="Surface", Values=area.Area)  # -> Model, QtoId
ifc_write = IfcWrite(Model=ifc_qto.Model, Write=Button())
